# Dynamo graph Dimension Lines.dyn (Dynamo 2.19.3.6394)

code_block = CodeBlock()
# ---------- code_block.designscript (13 lines) ----------
// Dimension Lines v0.1
// by Justin Martinez
// 2025-01-26

// Draw detail lines,
// Group those detail lines and go inside group.
// Click "Select" and drag selection box around these lines.
// Script will add dimension lines on selected detail lines OUTSIDE the group.
// See the Script output. Script will list sum dimension line lengths by line type.
// Exit group editing to see dimensions.

// Optional: Go back inside group, click "Add" and click those
// individual dimension lines to add them to the group.
# ----------------------------------------

# group: Archive
draw_dimension_lines = Python()  # CPython3; frozen; unwired: IN[0]
# ---------- draw_dimension_lines.python (68 lines) ----------
import clr

# Import RevitServices & Revit API
clr.AddReference("RevitServices")
import RevitServices
from RevitServices.Persistence import DocumentManager
from RevitServices.Transactions import TransactionManager

clr.AddReference("RevitAPI")
import Autodesk
from Autodesk.Revit.DB import *

# Current Revit Document
doc = DocumentManager.Instance.CurrentDBDocument

# Handle single or multiple inputs from Dynamo
input_elements = IN[0]
if not isinstance(input_elements, list):
    input_elements = [input_elements]  # Wrap single input in a list

# Unwrap elements properly
detail_curves = [UnwrapElement(x) for x in input_elements]

# List to store created dimensions
created_dimensions = []

# Start Transaction
TransactionManager.Instance.EnsureInTransaction(doc)

for dc in detail_curves:
    # Ensure the selected element is a DetailCurve
    if isinstance(dc, DetailCurve):
        
        # Get the curve geometry of the DetailCurve
        curve = dc.GeometryCurve
        
        # Get references for both endpoints of the curve
        ref_start = curve.GetEndPointReference(0)  # Start point reference
        ref_end = curve.GetEndPointReference(1)    # End point reference
        
        # Validate that both references are available
        if ref_start and ref_end:
            ref_array = ReferenceArray()
            ref_array.Append(ref_start)
            ref_array.Append(ref_end)
            
            # Create an offset vector
            offset_vector = XYZ(3, 3, 0)  # Adjust offset direction and magnitude
            
            # Offset the line's start and end points
            offset_start = curve.GetEndPoint(0).Add(offset_vector)
            offset_end = curve.GetEndPoint(1).Add(offset_vector)
            
            # Create a new dimension line
            dimension_line = Line.CreateBound(offset_start, offset_end)
            
            try:
                # Try creating the dimension
                new_dim = doc.Create.NewDimension(doc.ActiveView, dimension_line, ref_array)
                created_dimensions.append(new_dim)
            except Exception as e:
                # Handle errors (e.g., if editing a group and it fails)
                created_dimensions.append(f"Error: {e}")

TransactionManager.Instance.TransactionTaskDone()

# Output the created dimensions to Dynamo
OUT = created_dimensions
# ----------------------------------------
watch = Watch(draw_dimension_lines)

select_model_elements = DSModelElementsSelection()  # 4 picked in the model
draw_and_total_dimension_lines = Python(IN[0]=select_model_elements)  # CPython3
# ---------- draw_and_total_dimension_lines.python (79 lines) ----------
import clr

# Import RevitServices & Revit API
clr.AddReference("RevitServices")
import RevitServices
from RevitServices.Persistence import DocumentManager
from RevitServices.Transactions import TransactionManager

clr.AddReference("RevitAPI")
import Autodesk
from Autodesk.Revit.DB import *

# Current Revit Document
doc = DocumentManager.Instance.CurrentDBDocument

# Handle single or multiple inputs from Dynamo
input_elements = IN[0]
if not isinstance(input_elements, list):
    input_elements = [input_elements]  # Wrap single input in a list

# Unwrap elements properly
detail_curves = [UnwrapElement(x) for x in input_elements]

# List to store created dimensions
created_dimensions = []

# Dictionary to store line type and total length
line_type_lengths = {}

# Start Transaction
TransactionManager.Instance.EnsureInTransaction(doc)

for dc in detail_curves:
    # Ensure the selected element is a DetailCurve
    if isinstance(dc, DetailCurve):
        # Get the curve geometry of the DetailCurve
        curve = dc.GeometryCurve
        
        # Get the line style (type) of the curve
        line_type = dc.LineStyle.Name
        
        # Get references for both endpoints of the curve
        ref_start = curve.GetEndPointReference(0)  # Start point reference
        ref_end = curve.GetEndPointReference(1)    # End point reference
        
        # Validate that both references are available
        if ref_start and ref_end:
            ref_array = ReferenceArray()
            ref_array.Append(ref_start)
            ref_array.Append(ref_end)
            
            # Create an offset vector
            offset_vector = XYZ(2, 2, 0)  # Adjust offset direction and magnitude
            
            # Offset the line's start and end points
            offset_start = curve.GetEndPoint(0).Add(offset_vector)
            offset_end = curve.GetEndPoint(1).Add(offset_vector)
            
            # Create a new dimension line
            dimension_line = Line.CreateBound(offset_start, offset_end)
            
            try:
                # Try creating the dimension
                new_dim = doc.Create.NewDimension(doc.ActiveView, dimension_line, ref_array)
                created_dimensions.append(new_dim)
                
                # Add the curve length to the total for its line type
                if line_type not in line_type_lengths:
                    line_type_lengths[line_type] = 0
                line_type_lengths[line_type] += curve.Length
            
            except Exception as e:
                # Handle errors (e.g., if editing a group and it fails)
                created_dimensions.append(f"Error: {e}")

TransactionManager.Instance.TransactionTaskDone()

# Output the created dimensions and line type lengths to Dynamo
OUT = (created_dimensions, line_type_lengths)
# ----------------------------------------
